# Dynamo graph Estudo de exportação de tabelas.dyn (Dynamo 2.10.1.3976)

# group: Test1
categories = Categories("OST_Walls")
watch = Watch(categories)
categories_2 = Categories("OST_Walls")
all_elements_of_category = ElementsOfCategory(Category=categories_2)
wall_types = WallTypes("Parede de alvenaria")

categories_3 = Categories("OST_Schedules")
all_elements_of_category_2 = ElementsOfCategory(Category=categories_3)
code_block = CodeBlock(list=all_elements_of_category_2) { list[22]. Name+ "this is a new test.csv"; list; }
string = StringInput("C:\Users\vinic\OneDrive\Área de Trabalho\")
code_block_2 = CodeBlock(dir=string, file=code_block.out0) { dir+file; }
byProperties = Revit.Schedules.ScheduleExportOptions.ByProperties()
export = ScheduleView.Export(scheduleView=code_block.list, path=code_block_2, exportOptions=byProperties)
views = Views("Levantamento do material de parede")
view_family_types = ViewFamilyTypes("Tabela")
watch_2 = Watch(code_block_2)
